# Grasshopper definition 3_1_PathManipulator.gh (Grasshopper 1.0.8)

# ---- group: Attractor Point
point = Point(<point referenced from the Rhino model>)

# ---- group: Print Path
# Path Manipulator 01
# by Korbinian Enzinger
curve = Curve()

# ----
g_code_manipulator = GCodeManipulator(curve=curve, point_b=point)
curve_2 = Curve(g_code_manipulator)

# ==== cluster GCodeManipulator: G-Code Manipulator
curve = ClusterInput()
curve_2 = Curve(curve)
control_points = ControlPoints(Curve=curve_2)  # -> Points, Weights, Knots

# ---- group: Finding the Normals
curve_closest_point = CurveClosestPoint(Point=control_points.Points, Curve=curve_2)  # -> Point, Parameter, Distance
evaluate_curve = EvaluateCurve(Curve=curve_2, Parameter=curve_closest_point.Parameter)  # -> Point, Tangent, Angle
line_sdl = LineSDL(Start=evaluate_curve.Point, Direction=evaluate_curve.Tangent, Length=1)
rotate = Rotate(Geometry=line_sdl, Angle=degrees(Slider(90, range=0..100)), Plane=evaluate_curve.Point)  # -> Geometry, Transform

# ----
point_b = ClusterInput()
distance = Distance(PointA=evaluate_curve.Point, PointB=point_b)
curve_3 = Curve(rotate.Geometry)

# ---- group: Selecting every second point
cull_pattern = CullPattern(List=evaluate_curve.Point, CullPattern=[False, True])
cull_pattern_2 = CullPattern(List=evaluate_curve.Point, CullPattern=[True, False])

# ----
cull_pattern_3 = CullPattern(List=curve_3, CullPattern=[False, True])
cull_pattern_4 = CullPattern(List=distance, CullPattern=[False, True])

# ---- group: Remap Numbers
construct_domain = ConstructDomain(DomainStart=Slider(0, range=0..100), DomainEnd=Slider(4, range=0..10))
bounds = Bounds(Numbers=cull_pattern_4)
remap_numbers = RemapNumbers(Value=cull_pattern_4, Source=bounds, Target=construct_domain)  # -> Mapped, Clipped
graph_mapper = GraphMapper(remap_numbers.Mapped, x0=0, x1=1, y0=0, y1=1, container_name="Sine", Equation_px=[0, 0.3240751326], Equation_py=[0, 1])

# ----
line_sdl_2 = LineSDL(Start=cull_pattern, Direction=cull_pattern_3, Length=graph_mapper)
deconstruct_vector = DeconstructVector(Vector=line_sdl_2)  # -> XComponent, YComponent, ZComponent
negative = Negative(Value=deconstruct_vector.XComponent)
negative_2 = Negative(Value=deconstruct_vector.YComponent)
vector_xyz = VectorXYZ(XComponent=negative, YComponent=negative_2, ZComponent=0)  # -> Vector, Length
move = Move(Geometry=cull_pattern, Motion=vector_xyz.Vector)  # -> Geometry, Transform
weave = Weave(Pattern=[0, 1], Stream0=cull_pattern_2, Stream1=move.Geometry, NullGaps=False)
polyline = PolyLine(Vertices=weave, Closed=False)
polyline_2 = ClusterOutput(polyline)
